# Grasshopper definition AddSurfaceArea.gh (Grasshopper 1.0.7)
# plug-ins: RhinoCityJSON

# ---- group: Adjust to file!
toggle = BooleanToggle(False)
path = FilePath()
pt = Point(Point(0, 0, 0))
panel = Panel("50")
panel_2 = Panel("2")

# ----
rsettings = ReaderSettings(Translate=toggle, ModelOrigin=pt, TrueNorth=panel, LoD=panel_2)
reader = RCJReader(Path=path, Activate=Toggle(True), Settings=rsettings)  # -> Geometry, SurfaceInfoKeys, SurfaceInfoVales, ObjectInfoKeys, ObjectInfoValues
merge = Merge(Data1=reader.SurfaceInfoKeys, Data2=graft("Surface Area"))
area = Area(Geometry=reader.Geometry)  # -> simplify(graft(Area)), Centroid
merge_2 = Merge(Data1=reader.SurfaceInfoVales, Data2=area.Area)
idivide = InformationDivider(
    SurfaceInfoKeys=merge,
    SurfaceInfoVales=merge_2,
    ObjectInfoKeys=reader.ObjectInfoKeys,
    ObjectInfoValues=reader.ObjectInfoValues)  # -> MergedSurfaceInfoKeys, MergedSurfaceInfoVales
bakery = RCJBakery(
    Geometry=reader.Geometry,
    SurfaceInfoKeys=idivide.MergedSurfaceInfoKeys,
    SurfaceInfo=idivide.MergedSurfaceInfoVales,
    Activate=Button())
