# Grasshopper definition IsolateRooftypes.gh (Grasshopper 1.0.7)
# plug-ins: RhinoCityJSON

# ---- group: Adjust to file!
toggle = BooleanToggle(False)
path = FilePath()
pt = Point(Point(0, 0, 0))
panel = Panel("50")
panel_2 = Panel("1.3")

# ----
rsettings = SettingsReader(Translate=toggle, ModelOrigin=pt, TrueNorth=panel, LoD=panel_2, LargeFiles=False)
oreader = ReaderObjects(Path=path, Activate=Toggle(True), Settings=rsettings)  # -> Geometry, SurfaceInformation, ObjectInformation
object_filter = ObjectKeys({"Object Name": 0, "Object Type": 1, "Object Parent": 2, "Object Child": 3, "Object dak_type": 4, "Object data_area": 5, "Object data_coverage": 6, "Object documentnummer": 7, "Object geconstateerd": 8, "Object gid": 9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}, selected="Object dak_type")
filter = AttributeFilter(InformationObjects=oreader.ObjectInformation, FilterKey=object_filter, FilterValue="multiple horizontal")
imanage = InformationManager(Geometry=oreader.Geometry, SurfaceInfo=oreader.SurfaceInformation, ObjectInfo=filter)  # -> Geometry, MergedSurfaceInformation

# ---- group: IManage resolves the geometry filtering
preview = CustomPreview(Geometry=imanage.Geometry, Material=ColourSwatch(SwatchColor=RGB(255, 255, 0)))
